# Grasshopper definition RhinoGH_cs_01.gh (Grasshopper 0.9.76)

pt = Point([<point referenced from the Rhino model> x8])
pt_2 = Point([<point referenced from the Rhino model> x8])

# ---- group: 03-1
c_script = CSharpScript(pts=pt)  # -> out, A; inputs pts: list of Point3d
# ---------- c_script: C# ----------
    Line[] ln = new Line[pts.Count() - 1];

    for (int i = 0; i < ln.Length; i++){
      ln[i] = new Line(pts[i], pts[i + 1]);
    }

    A = ln;
# ---------- end c_script ----------

# ---- group: 03-2
c_script_2 = CSharpScript(pts=pt_2)  # -> out, A; inputs pts: list of Point3d
# ---------- c_script_2: C# ----------
    Line[] ln = new Line[pts.Count()];

    for (int i = 0; i < pts.Count(); i++){
      int friend = i;
      double closest = 10000;
      for (int j = 0; j < pts.Count(); j++){
        if (j != i){
          double dist = pts[i].DistanceTo(pts[j]);
          if (dist < closest) {
            closest = dist;
            friend = j;
          }
        }
      }
      ln[i] = new Line(pts[i], pts[friend]);
    }

    A = ln;
# ---------- end c_script_2 ----------

# ---- group: 01-4
c_script_3 = CSharpScript(x=Slider(5, range=0..10), y=Slider(5, range=0..10), z=Slider(7, range=0..10))  # -> out, A; inputs x: Double, y: Double, z: Double
# ---------- c_script_3: C# ----------
    Point3d pt = new Point3d();
    Sphere s;

    pt.X = x;
    pt.Y = y;
    pt.Z = z;

    s = new Sphere(pt, 20);
    A = s;
# ---------- end c_script_3 ----------

# ---- group: 02-3
c_script_4 = CSharpScript()  # -> out, A
# ---------- c_script_4: C# ----------
    Point3d[] myPoints = new Point3d[10];
    for (int i = 0; i < myPoints.Length; i++){
      Point3d tempPt = new Point3d(i, i, 0);
      myPoints[i] = tempPt;
    }
    A = myPoints;
# ---------- end c_script_4 ----------

# ---- group: 02-1
c_script_5 = CSharpScript()  # -> out, A
# ---------- c_script_5: C# ----------
    int[] myArray = new int[] {0,5,6};
    A = myArray;
# ---------- end c_script_5 ----------

# ---- group: 01-3
c_script_6 = CSharpScript(x=Slider(5, range=0..10), y=Slider(5, range=0..10), z=Slider(7, range=0..10))  # -> out, A; inputs x: Double, y: Double, z: Double
# ---------- c_script_6: C# ----------
    Point3d pt;

    pt = new Point3d();

    pt.X = x;
    pt.Y = y;
    pt.Z = z;

    A = pt;
# ---------- end c_script_6 ----------

# ---- group: 02-2
c_script_7 = CSharpScript()  # -> out, A
# ---------- c_script_7: C# ----------
    int[] myArray = new int[10];

    // for (initialization-clause; condition-clause; iteration-clause) { statement-block; }
    for (int i = 0; i < myArray.Length; i++){
      myArray[i] = i;
    }

    A = myArray;
# ---------- end c_script_7 ----------

# ---- group: 01-2
c_script_8 = CSharpScript(x=Slider(5, range=0..10), y=Slider(5, range=0..10), z=Slider(7, range=0..10))  # -> out, A; inputs x: Double, y: Double, z: Double
# ---------- c_script_8: C# ----------
    Point3d pt;
    
    pt = new Point3d();
    
    pt.X = x;
    pt.Y = y;
    pt.Z = z;

    A = pt;
# ---------- end c_script_8 ----------

# ---- group: 01-1
c_script_9 = CSharpScript()  # -> out, A
# ---------- c_script_9: C# ----------
    Point3d pt = new Point3d();

    pt.X = 0;
    pt.Y = 0;
    pt.Z = 0;

    A = pt;
# ---------- end c_script_9 ----------
